# Grasshopper definition app.gh (Grasshopper 1.0.7)

number_slider = Slider(4, range=0..6)
number_slider_2 = Slider(0.06, range=0.01..0.1)
number_slider_3 = Slider(2, range=0..6)
concatenate = Concatenate(FragmentA="http://127.0.0.1:5000", FragmentB="/Graph_network_gh")
